# Grasshopper definition basic-cs-component.gh (Grasshopper 1.0.7)

point = Point([Point(54.32033387, 37.35023927, 0), Point(10.95109659, -3.205336866, 22.91179764), Point(0, -1.503648463, 9.255571295), Point(0, -9.549398955, -4.064615966), Point(0, -1.028396811, -8.472030868), Point(25.69049546, 1.948927784, 37.85694524), Point(6.641447727, 0, 29.84844269), Point(-109.4830135, -101.6425078, 0)])
foreach = CSharpScript(points=point)  # -> out, A; inputs points: list of Point3d
# ---------- foreach: C# ----------
    List<Circle> myCircles = new List<Circle>();

    foreach (Point3d point in points)
    {
      Circle circle = new Circle(point, 10.0);
      myCircles.Add(circle);
    }
    
    A = myCircles;
# ---------- end foreach ----------
some_beginner_stuff = CSharpScript(x1=Slider(0.5, range=0..1), x2=Slider(0, range=0..1), x3=Slider(1, range=0..1))  # -> out, A, B, C; inputs x1: Double, x2: Double, x3: Double
# ---------- some_beginner_stuff: C# ----------
    Point3d p1 = new Point3d(x1, x2, x3);
    Point3d p2 = new Point3d(x2, x3, x1);
    Point3d p3 = new Point3d(x3, x1, x2);
    A = p1;
    B = p2;
    C = p3;
    Print(x1.ToString());
    Print(" ");

    for (int i = 0; i < 3; i++)
    {
      Print(i.ToString());
      RhinoApp.WriteLine(i.ToString());
    }
    Print(" ");

    List<double> myNumbers = new List<double>(){0.5,3.14,x1,x2,x3};
    Print(myNumbers.ToString());
# ---------- end some_beginner_stuff ----------
for_loop_and_list = CSharpScript()  # -> out, A
# ---------- for_loop_and_list: C# ----------
    List<Point3d> myPoints = new List<Point3d>();

    for(int i = 0; i < 100; i++)
    {
      for(int j = 0; j < 20; j++)
      {
        myPoints.Add(new Point3d(j * 2, i, j * 0.4));
      }
    }



    A = myPoints;
# ---------- end for_loop_and_list ----------
panel = Panel(some_beginner_stuff.out)
panel_2 = Panel([some_beginner_stuff.A, some_beginner_stuff.B, some_beginner_stuff.C])
